# Grasshopper definition writeLinesToJson.gh (Grasshopper 1.0.7)
# plug-ins: NGon

crv = Curve([<curve referenced from the Rhino model> x4])
python = GhPythonScript(
    lines=crv,
    writeJson=Toggle(True),
    fileName="InternalForceWandscheibe.json",
    address="/Users/yang/DriveDBT/20230922_Innovedum/0115/json")  # -> out, a; inputs lines: list of Line, writeJson: Boolean
# ---------- python: Python ----------
__author__ = "yang"

import rhinoscriptsyntax as rs
import Rhino.Geometry as rg
import json
import os

if writeJson:
    
    jsonContent = []
    for i in range(len(lines)):
        jsonContent.append(
        [[lines[i].PointAt(0).X,
        lines[i].PointAt(0).Y,
        lines[i].PointAt(0).Z],
        [lines[i].PointAt(1).X,
        lines[i].PointAt(1).Y,
        lines[i].PointAt(1).Z]]
        )
    jsonContent = {"lines": jsonContent}
    jsonObj = json.dumps(jsonContent, indent=4)
    
    path = os.path.join(address, fileName)
    
    with open(path, "w") as outFile:
        outFile.write(jsonObj)
# ---------- end python ----------
number_slider = Slider(0.01, range=0..0.1)
crv_2 = Curve([<curve referenced from the Rhino model> x8])
meshpipe = MeshPipe(Curve=crv_2, Radius=Slider(0.006, range=0..0.01), Sides=Slider(4, range=0..10), Tolerance=10, Ending=3)
